# Grasshopper definition stepper_control.gh (Grasshopper 1.0.7)
# plug-ins: Swiftlet

number_slider = Slider(2, range=0..100)
control_knob = ControlKnob(Decimals=0, Limit=True, Maximum=200, Minimum=0, Range=200, Value=181)
create_query_param = CreateQueryParam(Key="steps", Value=control_knob)
data_dam = DataDam(DataA=create_query_param, BufferDelay=2500000, BufferMode=2)
get_request = GETRequest(URL="http://192.168.0.112/stepper", Params=data_dam)  # -> Status, Content, Response
panel = Panel(get_request.Status)
